# Grasshopper definition FindTangent.gh (Grasshopper 1.0.7)
# Copyright: Mathieu van Leemputten
# plug-ins: EnterTheVoid

circle = Circle(Plane=PlaneXY(0, 0, 0), Radius=Slider(10, range=0..10))
point = Point(Point(15.36784252, 13.6397926, 0))
findtangents = FindTangents(Circle=circle, Point=point)  # -> PointA, PointB
tangent_lines = TangentLines(Point=point, Circle=circle)  # -> Tangent1, Tangent2
line = Line(StartPoint=[findtangents.PointB, findtangents.PointA], EndPoint=point)
