# Grasshopper definition GrasshopperRemoveInterferingCurves.gh (Grasshopper 1.0.7)
# Copyright: Mathieu van Leemputten
# plug-ins: EnterTheVoid

brep = Brep(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)
curve = Curve([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])
removeinterferinglines = RemoveInterferingLines(Use=Toggle(False), Brep=brep, Curves=curve)  # -> CurvesOut, Points
point = Point(removeinterferinglines.Points)
curve_2 = Curve(removeinterferinglines.CurvesOut)
