# Grasshopper definition PluginEnterTheVoidTest.gh (Grasshopper 1.0.7)
# Copyright: Mathieu van Leemputten
# plug-ins: EnterTheVoid

geometry = Geometry([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])
area = Area(Geometry=geometry)  # -> Area, Centroid
unit_z = UnitZ(Factor=Slider(100, range=0..100))
point = Point(area.Centroid)
unit_z_2 = UnitZ(Factor=Slider(5, range=0..10))
brep = Brep(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)
move = Move(Geometry=point, Motion=unit_z)  # -> Geometry, Transform
construct_point = ConstructPoint(XCoordinate=Slider(1, range=0..10), YCoordinate=Slider(2, range=0..10), NumberSlider=Slider(4, range=0..10))
move_2 = Move(Geometry=brep, Motion=unit_z_2)  # -> Geometry, Transform
line = Line(StartPoint=area.Centroid, EndPoint=move.Geometry)
sphere = Sphere(Base=PlaneXY(0, 0, 0), Radius=1)
curve = Curve(line)
brep_2 = Brep(move_2.Geometry)
enterthevoidfinal = EnterTheVoidFinal(
    Reset=Toggle(False),
    ICount=Slider(41, range=1..100),
    BrepVoid=brep_2,
    RandomPoint=construct_point,
    CCurves=curve,
    BrepEntrance=sphere)  # -> Cones, Pts, ConnectionLines
geometry_2 = Geometry(enterthevoidfinal.Cones)
plane = Plane()
point_2 = Point(enterthevoidfinal.Pts)
line_2 = Line(enterthevoidfinal.ConnectionLines)
list_length = ListLength(List=geometry_2)
panel = Panel(list_length)
list_length_2 = ListLength(List=line_2)
panel_2 = Panel(list_length_2)
list_length_3 = ListLength(List=point_2)
panel_3 = Panel(list_length_3)
