# Grasshopper definition bomen.gh (Grasshopper 1.0.7)
# plug-ins: EnterTheVoid

curve = Curve([<curve referenced from the Rhino model> x22])
deconstruct_arc = DeconstructArc(Arc=curve)  # -> BasePlane, Radius, Angle
point = Point(deconstruct_arc.BasePlane)
unit_z = UnitZ(Factor="1200")
move = Move(Geometry=point, Motion=unit_z)  # -> Geometry, Transform
unit_z_2 = UnitZ(Factor=Slider(298, range=0..1100))
line = Line(StartPoint=point, EndPoint=move.Geometry)  # -> flatten(Line)
brep = Brep(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)
sweep1 = Sweep1(Rail=graft(line), Sections=graft(curve), Miter=1)
number_slider = Slider(2, range=0..10)
list_item = ListItem(List=line, Index=number_slider, Wrap=True)
move_2 = Move(Geometry=brep, Motion=unit_z_2)  # -> Geometry, Transform
construct_domain = ConstructDomain(DomainStart="0", DomainEnd="1")
random = Random(Range=construct_domain, Number=Slider(1, range=0..10), Seed=number_slider)
evaluate_curve = EvaluateCurve(Curve=list_item, Parameter=random)  # -> Point, Tangent, Angle
point_2 = Point(evaluate_curve.Point)
curve_2 = Curve(line)
sphere = Sphere(Base=PlaneXY(0, 0, 0), Radius=1)
enterthevoidfinal = EnterTheVoidFinal(
    Reset=Toggle(False),
    ICount=Slider(1001, range=1..1001),
    BrepVoid=move_2.Geometry,
    RandomPoint=point_2,
    CCurves=curve_2,
    BrepEntrance=sphere)  # -> Cones, Pts, ConnectionLines
curve_3 = Curve(enterthevoidfinal.ConnectionLines)
