# Grasshopper definition grasshopperTrees.gh (Grasshopper 1.0.7)
# plug-ins: EnterTheVoid

# ---- group: sphere
unit_z = UnitZ(Factor=Slider(298, range=0..1100))
brep = Brep(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)
move = Move(Geometry=brep, Motion=unit_z)  # -> Geometry, Transform

# ---- group: Connection Curves
curve = Curve([<curve referenced from the Rhino model> x22])
deconstruct_arc = DeconstructArc(Arc=curve)  # -> BasePlane, Radius, Angle
unit_z_2 = UnitZ(Factor="1200")
point = Point(deconstruct_arc.BasePlane)
move_2 = Move(Geometry=point, Motion=unit_z_2)  # -> Geometry, Transform
line = Line(StartPoint=point, EndPoint=move_2.Geometry)  # -> flatten(Line)

# ---- group: Random Point
number = Slider(1, range=0..10)
seed = Slider(4, range=0..10)
construct_domain = ConstructDomain(DomainStart="0", DomainEnd="1")
random = Random(Range=construct_domain, Number=number, Seed=seed)
list_item = ListItem(List=line, Index=seed, Wrap=True)
evaluate_curve = EvaluateCurve(Curve=list_item, Parameter=random)  # -> Point, Tangent, Angle

# ---- group: brepEntrance
sphere = Sphere(Base=PlaneXY(0, 0, 0), Radius=1)

# ---- group: INPUT
number_slider = Slider(276, range=1..1001)
# DOT3 component
boolean_toggle = BooleanToggle(False)
geometry = Geometry(move.Geometry)
point_2 = Point(evaluate_curve.Point)
curve_2 = Curve(line)
geometry_2 = Geometry(sphere)

# ---- group: ENTER THE VOID
enterthevoid = EnterTheVoid(
    UseEntrance=boolean_toggle,
    ICount=number_slider,
    BrepVoid=geometry,
    RandomPoint=point_2,
    CCurves=curve_2,
    BrepEntrance=geometry_2)  # -> Cones, Pts, ConnectionCurves

# ---- group: OUTPUT
geometry_3 = Geometry(enterthevoid.Cones)
point_3 = Point(enterthevoid.Pts)
curve_3 = Curve(enterthevoid.ConnectionCurves)
